# Grasshopper definition clayToolkit_v0-6-0.gh (Grasshopper 1.0.7)
# plug-ins: Kangaroo2 Components, Pufferfish

# Change Log
# 05/10/2024 (0.6.0)
# ========
# - Cleaned up for GitHub
# 
# 01/10/2024 (0.5.3)
# ========
# - Added Tronxy Moore 2 Pro config
# - Fixed bugs with non-Potterbot machines
# 
# 08/23/2023 (0.5.2)
# ========
# - Scara functions better integrated
# - Added support for open toolpaths in basic slicer
# 
# 
# 08/15-16/2023 (0.5.1)
# ========
# - fixed a bug with slicing meshes
# - adjusted extrusion and clay use for small potterbot
# - added Scara, Eazao, Lutum and Brutum profiles
# - rewrote the gcode creation part in python. Limiting
# the extrusion values to avoid exploding upto millions
# - updated "center on bed" block, it now centers on
# a specific point (useful for Scara)
# - added extrusion multiplier option for all printers.
# Auto-extrusion toggle can be usef for Potterbots.
# 
# 
# 08/4/2023 (0.5.0)
# ========
# - added version and time to gcode files
# - clay usage works with Mini and Super
# - adjusted multiwall distances
# 
# 
# 08/3/2023
# ========
# - added multiwall support to slicer
# - reorganized gcode save and visualization groups
# - added an option for scaling only Z for gcode
# reexport
# - added multiwall support to reexporting the gcode
# 
# 
# 08/2/2023
# ========
# - dimension visualization
# - gcode import to change layer height and nozzle width
# --- layer height change scales the object
# 
# 
# 07/31/2023
# =========
# - GH metadata saved with gcode file
# - Layer and vertical patterns work with any integer now
# --- (0 disables patterning, anything else scales)
# - image texturing for slicing
# - [BUG] removed textures from rim layers
# 
# 
# 07/25/2023
# =========
# - multi wall support
# --- option: wall printing order
# - surface visualization for surface textures
current_version = Text("0.6.0")
panel = Panel(current_version)

# ----
# Printer Config
# adjust cx,cy,cz for Scara center
# only works with Potterbots
list = ValueList({"Potterbot 10 Super", "Potterbot Micro", "Potterbot Scara", "Tronxy Moore 2 Pro": "Tronxy", "LUTUM 5 (untested)": "LUTUM 5", "Eazao (untested)": "Eazao"}, selected="Potterbot Micro")
extrusion_multiplier = Slider(1, range=1..5)
print_speed_mm_s = Slider(40, range=0..200)
nozzle_diam_mm = Slider(4, range=0..7)
layer_height_mm = Slider(2, range=0..7)
auto_extrusion_mult = BooleanToggle(True)
p_config = GhPythonScript(p=list)  # -> centerPoint, startGcode, endGcode, tubeDiameter
# ---------- p_config: Python ----------
__author__ = "mert_"
__version__ = "2023.06.22"

import rhinoscriptsyntax as rs
import ghpythonlib.components as gh

_w,_d,_h = 0, 0, 0
_cx,_cy,_cz = 0, 0, 0
tubeDiameter = 0
startGcode = ""
endGcode = """;;; === END GCODE ===
M83                             ;Set to Relative Extrusion Mode
G28 Z                           ;Home Z
G91
G91                             ;Set Relative Positioning
G1 E-1000 F4000                 ;Depressurize the extruder
G90                             ;Set Absolute Movement
G90
M84                             ; Disable motors"""


if p == "Potterbot 10 Super":
    _w,_d,_h = 415, 405, 500
    _cx,_cy,_cz = _w/2, _h/2, 1
    tubeDiameter = 95
    startGcode = """;;;START GCODE P. 10 Super;;;
G90
M82                             ;Absolute extrusion mode
G28                             ;Home
G1 X{0:.2f} Y{1:.2f} F10000     ;Move X and Y to center
G1 Z20                          ;Move Z to 20mm high
G1 E4000 F30000                 ;Prime Extruder
G92 E0                          ;Zero the extruded length
;;; ======""".format(_cx, _cy)
elif p == "Potterbot Micro":
    _w,_d,_h = 280, 265, 305
    _cx,_cy,_cz = _w/2, _h/2, 1
    tubeDiameter = 70
    startGcode = """;;;START GCODE P. Micro;;;
M82                             ;Absolute extrusion mode
G28                             ;Home
G1 X{0:.2f} Y{1:.2f} F10000     ;Move X and Y to center
G1 Z20                          ;Move Z to 20mm high
G1 E2000 F10000                 ;Prime Extruder
G92 E0                          ;Zero the extruded length
;;; ======""".format(_cx, _cy)
elif p == "Potterbot Scara":
    _w,_d,_h = 2000, 2000, 1000
    
    #--- ADJUST THIS POINT ---
    _cx,_cy,_cz = -400, 400, 1
    #-------------------------
    
    tubeDiameter = 95
    startGcode = """;;;START GCODE P. Scara;;;
M82                             ;Absolute extrusion mode
G28                             ;Home
G1 Z20 F10000                   ;Z to 20mm high
G1 E2000 F10000                 ;Prime Extruder
G92 E0                          ;Zero the extruded length
;;; ======"""
elif p == "Tronxy":
    _w,_d,_h = 180, 180, 250
    _cx,_cy,_cz = 90, 90, 0.5
    tubeDiameter = -1
    startGcode = """;;;START GCODE Tronxy Moore Pro 2;;;
M105
M109 S0
M82             ;absolute extrusion mode
G28             ;Home
G1 Z15.0 F6000  ;Move the platform down 15mm
G92 E0
G1 F200 E3      ;Prime the extruder
G92 E0
G92 E0
G92 E0
;;; ======"""
    endGcode = """
M107
M104 S0
M140 S0
G92 E1          ;Retract the filament
G1 E-1 F300
G28 X0 Y0
M84
M82 ;absolute extrusion mode"""

elif p == "Eazao":
#    Layer Resolution	0.4 -1mm
#    Nozzle Diameter	1.5mm
#    Print Speed	    10mm/s - 40mm/s
    _w,_d,_h = 150, 150, 240
    _cx,_cy,_cz = 0, 0, 0.5
    tubeDiameter = -1   
    startGcode = """;;;START GCODE Eazao;;;
G21                             ;Metric values
G90                             ;Absolute positioning
M82                             ;Set extruder to absolute mode
G28 X0 Y0                       ;Move X/Y to min endstops
G28 Z0                          ;Move Z to min endstops
G1 Z15.0 F1500                  ;Move the platform down 15mm
G92 E0                          ;Zero the extruded length
G1 F200 E3                      ;Extrude 3mm of feed stock
G92 E0                          ;Zero the extruded length again
M302
G1 F1500
;M83                             ;Relative extrusion
M302 S0                         ;Always allow extrusion (disable checking)
M163 S0 P0.9                    ;Set Mix Factor
M163 S1 P0.1                    ;Set Mix Factor
M164 S0
;;; ======"""
elif p == "LUTUM 5":
    _w,_d,_h = 350, 350, 450 # Needs confirmation
    _cx,_cy,_cz = _w/2, _h/2, 1
    tubeDiameter = -1
    startGcode = """;;;START GCODE LUTUM 5;;;
G28                             ;home all axes
G1 Z3 F300                      ;move 3mm up with 300 speed
G21                             ;set units to millimeters
G90                             ;use absolute coordinates
M82                             ;use absolute distances for extrusion
G92 E0
;;; ======"""
elif p == "BRUTUM":
    _w,_d,_h = 430, 700, 820    # Needs confirmation
    _cx,_cy,_cz = _w/2, _h/2, 1 # Needs confirmation
    tubeDiameter = -1        
    startGcode = ""             # ??
else:
    print "unrecognized device"

centerPoint = rs.CreatePoint(_cx, _cy, _cz)
# ---------- end p_config ----------

# ----
# Printer Config
# adjust cx,cy,cz for Scara center
# only works with Potterbots
list_2 = ValueList({"Potterbot 10 Super", "Potterbot Micro", "Potterbot Scara", "Tronxy Moore 2 Pro": "Tronxy", "LUTUM 5 (untested)": "LUTUM 5", "Eazao (untested)": "Eazao"}, selected="Potterbot 10 Super")
extrusion_multiplier_2 = Slider(1, range=1..5)
print_speed_mm_s_2 = Slider(30, range=0..200)
nozzle_diam_mm_2 = Slider(5, range=0..7)
layer_height_mm_2 = Slider(2, range=0..7)
auto_extrusion_mult_2 = BooleanToggle(True)
p_config_2 = GhPythonScript(p=list_2)  # -> centerPoint, startGcode, endGcode, tubeDiameter
# ---------- p_config_2: Python ----------
__author__ = "mert_"
__version__ = "2023.06.22"

import rhinoscriptsyntax as rs
import ghpythonlib.components as gh

_w,_d,_h = 0, 0, 0
_cx,_cy,_cz = 0, 0, 0
tubeDiameter = 0
startGcode = ""
endGcode = """;;; === END GCODE ===
M83                             ;Set to Relative Extrusion Mode
G28 Z                           ;Home Z
G91
G91                             ;Set Relative Positioning
G1 E-1000 F4000                 ;Depressurize the extruder
G90                             ;Set Absolute Movement
G90
M84                             ; Disable motors"""


if p == "Potterbot 10 Super":
    _w,_d,_h = 415, 405, 500
    _cx,_cy,_cz = _w/2, _h/2, 1
    tubeDiameter = 95
    startGcode = """;;;START GCODE P. 10 Super;;;
M82                             ;Absolute extrusion mode
G28                             ;Home
G1 X{0:.2f} Y{1:.2f} F10000     ;Move X and Y to center
G1 Z20                          ;Move Z to 20mm high
G1 E4000 F30000                 ;Prime Extruder
G92 E0                          ;Zero the extruded length
;;; ======""".format(_cx, _cy)
elif p == "Potterbot Micro":
    _w,_d,_h = 280, 265, 305
    _cx,_cy,_cz = _w/2, _h/2, 1
    tubeDiameter = 70
    startGcode = """;;;START GCODE P. Micro;;;
M82                             ;Absolute extrusion mode
G28                             ;Home
G1 X{0:.2f} Y{1:.2f} F10000     ;Move X and Y to center
G1 Z20                          ;Move Z to 20mm high
G1 E2000 F10000                 ;Prime Extruder
G92 E0                          ;Zero the extruded length
;;; ======""".format(_cx, _cy)
elif p == "Potterbot Scara":
    _w,_d,_h = 2000, 2000, 1000
    
    #--- ADJUST THIS POINT ---
    _cx,_cy,_cz = -400, 400, 1
    #-------------------------
    
    tubeDiameter = 95
    startGcode = """;;;START GCODE P. Scara;;;
M82                             ;Absolute extrusion mode
G28                             ;Home
G1 Z20 F10000                   ;Z to 20mm high
G1 E2000 F10000                 ;Prime Extruder
G92 E0                          ;Zero the extruded length
;;; ======"""
elif p == "Tronxy":
    _w,_d,_h = 180, 180, 250
    _cx,_cy,_cz = 90, 90, 0.5
    tubeDiameter = -1
    startGcode = """;;;START GCODE Tronxy Moore Pro 2;;;
M105
M109 S0
M82             ;absolute extrusion mode
G28             ;Home
G1 Z15.0 F6000  ;Move the platform down 15mm
G92 E0
G1 F200 E3      ;Prime the extruder
G92 E0
G92 E0
G92 E0
;;; ======"""
    endGcode = """
M107
M104 S0
M140 S0
G92 E1          ;Retract the filament
G1 E-1 F300
G28 X0 Y0
M84
M82 ;absolute extrusion mode"""

elif p == "Eazao":
#    Layer Resolution	0.4 -1mm
#    Nozzle Diameter	1.5mm
#    Print Speed	    10mm/s - 40mm/s
    _w,_d,_h = 150, 150, 240
    _cx,_cy,_cz = 0, 0, 0.5
    tubeDiameter = -1   
    startGcode = """;;;START GCODE Eazao;;;
G21                             ;Metric values
G90                             ;Absolute positioning
M82                             ;Set extruder to absolute mode
G28 X0 Y0                       ;Move X/Y to min endstops
G28 Z0                          ;Move Z to min endstops
G1 Z15.0 F1500                  ;Move the platform down 15mm
G92 E0                          ;Zero the extruded length
G1 F200 E3                      ;Extrude 3mm of feed stock
G92 E0                          ;Zero the extruded length again
M302
G1 F1500
;M83                             ;Relative extrusion
M302 S0                         ;Always allow extrusion (disable checking)
M163 S0 P0.9                    ;Set Mix Factor
M163 S1 P0.1                    ;Set Mix Factor
M164 S0
;;; ======"""
elif p == "LUTUM 5":
    _w,_d,_h = 350, 350, 450 # Needs confirmation
    _cx,_cy,_cz = _w/2, _h/2, 1
    tubeDiameter = -1
    startGcode = """;;;START GCODE LUTUM 5;;;
G28                             ;home all axes
G1 Z3 F300                      ;move 3mm up with 300 speed
G21                             ;set units to millimeters
G90                             ;use absolute coordinates
M82                             ;use absolute distances for extrusion
G92 E0
;;; ======"""
elif p == "BRUTUM":
    _w,_d,_h = 430, 700, 820    # Needs confirmation
    _cx,_cy,_cz = _w/2, _h/2, 1 # Needs confirmation
    tubeDiameter = -1        
    startGcode = ""             # ??
else:
    print "unrecognized device"

centerPoint = rs.CreatePoint(_cx, _cy, _cz)
# ---------- end p_config_2 ----------

# ----
# Printer Config
# adjust cx,cy,cz for Scara center
# only works with Potterbots
list_3 = ValueList({"Potterbot 10 Super", "Potterbot Micro", "Potterbot Scara", "Tronxy Moore 2 Pro": "Tronxy", "LUTUM 5 (untested)": "LUTUM 5", "Eazao (untested)": "Eazao"}, selected="Tronxy Moore 2 Pro")
target_print_speed_mm_s = Slider(30, range=0..200)
target_nozzle_diam_mm = Slider(5, range=0..8)
target_layer_height_mm = Slider(4.99, range=0..7)
extrusion_multiplier_3 = Slider(1, range=1..5)
auto_extrusion_mult_3 = BooleanToggle(False)
p_config_3 = GhPythonScript(p=list_3)  # -> centerPoint, startGcode, endGcode, tubeDiameter; same code as p_config_2

# ----
# Surface Config
# Horizontal
# Vertical
pattern_strength = Slider(5, range=0..12)
enable_surface_textures = BooleanToggle(True)
vertical_pattern = Number([1, 0, 0, 0, -1, 0, 0, 0])
layer_pattern = Number([1, 0, -1, 0])

# ----
# Object Config
# set and connect
#     to relay depending on
# the input geometry type
point_distance_mm = Slider(2, range=2..10)
wall_count = Slider(2, range=1..3)
wall_order = ValueList({"Inside-Out": 0, "Outside-in": 1}, selected="Outside-in")
mesh = Mesh()
surface = Brep(<brep referenced from the Rhino model>)

# ----
# Object Config
rim_layers = Slider(1, range=0..5)
base_layers = Slider(2, range=0..5)
wall_count_2 = Slider(1, range=1..3)
of_points = Slider(2, range=2..12)
wall_order_2 = ValueList({"Inside-Out": 0, "Outside-in": 1}, selected="Inside-Out")
profile_curve = Curve(<curve referenced from the Rhino model>)

# ----
# takes long
# to calculate
skip_w_geometry = BooleanToggle(False)
geom_s_for_skipping = Geometry(<brep referenced from the Rhino model>)

# ----
# Original GCode Config
original_layer_height = Slider(3.7, range=0.5..6)
right_click_select_one_existing_file = FilePath()

# ----
# takes long
# to calculate
skip_w_geometry_2 = BooleanToggle(False)
geom_s_for_skipping_2 = Geometry()

# ----
# Surface Config
pattern_strength_2 = Slider(5, range=0..12)
enable_surface_textures_2 = BooleanToggle(True)
vertical_pattern_2 = Number([0, 0, 1])
layer_pattern_2 = Number([1, 0, 0, 0])
capex = CapHolesEx(Brep=geom_s_for_skipping_2)  # -> Brep, Caps, Solid

# ----
# Target GCode Config
# make sure the original
#   gcode has single wall
#         (may work poorly)
scale_type = ValueList({"Scale Z Only": 1, "Scale Uniformly": 0}, selected="Scale Uniformly")
wall_count_3 = Slider(1, range=1..3)
wall_order_3 = ValueList({"Inside-Out": 0, "Outside-in": 1}, selected="Inside-Out")

capex_2 = CapHolesEx(Brep=geom_s_for_skipping)  # -> Brep, Caps, Solid
_2msh = MeshBrep(
    Brep=surface,
    Settings={GridMaxCount=0, GridMinCount=16, JaggedSeams=False, MaxEdgeLength=0, MinEdgeLength=0.0001, MinTolerance=0, Refine=True, RefineAngle=0, RelativeTolerance=0.65, SimplePlanes=True, Tolerance=0})

# ---- group: Visualize surface
offset = Slider(0.66, range=0..1.2)
material = CreateMaterial(
    Diffuse=ColourSwatch(SwatchColor=RGB(31, 33, 28)),
    Specular=RGB(255, 255, 255),
    Emission=RGB(0, 0, 0),
    Transparency=0,
    Shine=Slider(0, range=0..1))
p_surf = GhPythonScript(t=offset, x=_2msh)  # -> G, A, B, L; inputs x: GeometryBase
# ---------- p_surf: Python ----------
__author__ = "mert_"
__version__ = "2023.08.03"

import rhinoscriptsyntax as rs
import ghpythonlib.components as gh
import math

xyPlane= gh.XYPlane(rs.CreatePoint(0,0,0))
box, _ = gh.BoundingBox(x, xyPlane)
_, xDom, yDom, zDom = gh.DeconstructBox(box)

xS, xE = gh.DeconstructDomain(xDom)
yS, yE = gh.DeconstructDomain(yDom)
zS, zE = gh.DeconstructDomain(zDom)

xscale = (xE+t)/xE
yscale = (yE+t)/yE
G, _ = gh.ScaleNU(x, xyPlane, xscale, yscale, 1)

A = rs.CreatePoint(xE, 0, 0)
B = rs.CreatePoint(xE, 0, zE)

A_ = rs.CreatePoint(xE+15, 0, 0)
B_ = rs.CreatePoint(xE+15, 0, zE)
L = rs.AddLine(A_, B_)
# ---------- end p_surf ----------
preview = CustomPreview(Geometry=p_surf.G, Material=material)

# ---- group: Height of vessel
lineardim = LinearDimension(Line=p_surf.L, PointA=p_surf.A, PointB=p_surf.B, Text="{0:0.00 mm}", Size=Slider(6, range=1..20))

# ----
p_readgcode = GhPythonScript(file=right_click_select_one_existing_file, ogLayerH=original_layer_height)  # -> vertices, origin
# ---------- p_readgcode: Python ----------
__author__ = "mert_"
__version__ = "2023.08.02"

import rhinoscriptsyntax as rs
import ghpythonlib.components as gh

with open(file, "r") as f:
    lines = f.readlines()

# Extracting the vertices from the G-code file (by ChatGPT)
vertices = []
firstLayer = []
for line in lines:
    line = line.strip()  # Remove leading and trailing whitespaces
    if line.startswith("G0") or line.startswith("G1"):
        # Extracting X, Y, and Z values
        x_value = float(line.split("X")[1].split()[0]) if "X" in line else None
        y_value = float(line.split("Y")[1].split()[0]) if "Y" in line else None
        z_value = float(line.split("Z")[1].split()[0]) if "Z" in line else None
        e_value = float(line.split("E")[1].split()[0]) if "E" in line else None
        if x_value is not None and y_value is not None and e_value is not None: 
            p = rs.CreatePoint(x_value, y_value, z_value)
            vertices.append(p)
            if z_value < ogLayerH: 
                firstLayer.append(p)
                
origin = gh.Average(firstLayer)
origin.Z = 0
# ---------- end p_readgcode ----------
p_parametriccylinderwithbase = GhPythonScript(
    Profile=profile_curve,
    BaseLayerCount=base_layers,
    WallCount=wall_count_2,
    WallOrder=wall_order_2,
    RimLayerCount=rim_layers,
    nPoints=of_points,
    NozzleWidth=nozzle_diam_mm,
    LayerHeight=layer_height_mm,
    isTextured=enable_surface_textures)  # -> surface, lastWallLayer, baseVertices, wallVertices, wallNormals, wallUVs; inputs Profile: Curve, BaseLayerCount: Int32, WallCount: Int32, WallOrder: Int32, RimLayerCount: Int32, nPoints: Int32, isTextured: Boolean
# ---------- p_parametriccylinderwithbase: Python ----------
__author__ = "mert_toka"
__version__ = "2022.04.29"

import rhinoscriptsyntax as rs  # rhino functionality
import ghpythonlib.components as gh        # grasshopper functionality 
import math

# input
Profile                         # Determines the Radii and Height
Height = 0
Radii = []
NozzleWidth
LayerHeight
BaseLayerCount
RimLayerCount

# output
baseVertices = []
wallVertices = []
wallNormals = []
wallUVs = []
lastWallLayer = []

# 
_ogPoint = rs.CreatePoint(0,0,0)
_upOgPoint = rs.CreatePoint(0,0,1)
_xyPlane = gh.XYPlane(_ogPoint)

def calculatePointCount(circumference):
    if nPoints < 3:
        return int(circumference * 0.5)       # One vertex every 2 mm
    else:
        return nPoints

# BASE
def makeBaseLayers(base_index):
    Radius = Radii[0]                               # Base radius
    
    base_index *= 2                                 # Each base layer consists 
                                                    # of two layers
    
    lineSpacing = NozzleWidth+LayerHeight-LayerHeight*(1-math.pi*0.25)
    spiralCount = math.ceil(Radius / lineSpacing) 
    
    _r_dec = Radius / spiralCount                   # Radius decrement
    _r = Radius
    
    for i in range(int(2*spiralCount+1)):
        circumference = math.pi*2*_r
        pointCount = calculatePointCount(circumference)
        for j in range(pointCount):
            ang = math.pi*2 * j/pointCount          # Angle of the polar coord.
    
            x = math.cos(ang)*_r
            y = math.sin(ang)*_r
            z = base_index*LayerHeight
            if i >= spiralCount:                    # Second base layer
                z = (base_index+1)*LayerHeight
            baseVertices.append(rs.CreatePoint(x,y,z))
        if i < spiralCount:                         # First or second base layer
            _r -= _r_dec
        else:
            _r += _r_dec

# WALLS
def makeWallLayer(i, isSeamless, radiusMod = 0):
    layerCount = int(Height / LayerHeight)     # number of total layers
    
    Radius = Radii[i]+radiusMod                # Parametric radius + optional modifier
    
    wallStartZ = BaseLayerCount*2*LayerHeight  # Height where walls start
    
    circumference = math.pi*2*Radius           # Circumference of the layer
    pointCount = calculatePointCount(circumference)
    for j in range(pointCount):
        ang = math.pi*2/pointCount * j
        z_inc = LayerHeight/pointCount           # Amount to raise each point
                                                 # for seamless toolpath
        # Vertices
        x = math.cos(ang)*Radius
        y = math.sin(ang)*Radius
        z = wallStartZ + i*LayerHeight 
        if i == layerCount-1:
            lastWallLayer.append(rs.CreatePoint(x,y,z))
        if isSeamless:
            # Amount to move xy coordinates while spiralizing
            x_inc = math.cos(ang)*(Radii[i+1]-Radius)/pointCount
            y_inc = math.sin(ang)*(Radii[i+1]-Radius)/pointCount
            
            x += j*x_inc
            y += j*y_inc
            z += j*z_inc
        wallVertices.append(rs.CreatePoint(x,y,z))
        
        # Normals
        normal = rs.CreateVector(x,y,0)
        normal.Unitize()
        wallNormals.append(normal)
        
        #UVs
        uv = rs.CreateVector(float(j)/pointCount, float(i)/int(Height / LayerHeight))
        wallUVs.append(uv)
# adds additional points for texturing in polygonal forms
def prepareWallsForTexturing(i): 
    global wallVertices, wallNormals, wallUVs 
    
    ps = []
    pn = []
    puv = []
    layerWallPoints = wallVertices[-WallCount*nPoints:]
    for w in range(WallCount):
        layerVertices = layerWallPoints[w*nPoints:(w+1)*nPoints]
        dist = gh.Distance(layerVertices[0], layerVertices[1])
        pointCount = int(dist * 0.5)
        up = gh.UnitZ(1)
        
        for j in range(nPoints):
            p1 = layerVertices[(j)]
            p2 = layerVertices[(j+1)%nPoints]
            
            v, _ = gh.CrossProduct(p2-p1, up, True)
            
            for k in range(pointCount):
                _k = float(k)/pointCount
                ps.append(p2*_k + p1*(1-_k))
                pn.append(v)
                puv.append(rs.CreateVector(float(j*pointCount+k)/(pointCount*nPoints), float(i)/int(Height / LayerHeight)))
    wallVertices = wallVertices[:-WallCount*nPoints]
    wallVertices.extend(ps)
    wallNormals = wallNormals[:-WallCount*nPoints]
    wallNormals.extend(pn)
    wallUVs = wallUVs[:-WallCount*nPoints]
    wallUVs.extend(puv)
    
def makeWalls():
    def makeInnerWalls(l):
        for p in l:
            makeWallLayer(i, False, -p*(NozzleWidth*0.9))

    layerCount = int(Height / LayerHeight)
    # Walls
    for i in range(layerCount):
        tmp = range(1, WallCount)
        if WallOrder == 0:                   # Inside to outside
            tmp.reverse()
            makeInnerWalls(tmp)
            makeWallLayer(i, WallCount == 1)
        else:                                # Outside to inside
            makeWallLayer(i, WallCount == 1) 
            makeInnerWalls(tmp)
        if isTextured and nPoints>2:         # Add extra points for surface textures if not circular
            prepareWallsForTexturing(i)
        
    # Repeated rim layers
    for j in range(RimLayerCount):
        makeWallLayer(i+1, False, -j*0.025)

# Determine Height and Radii from the profile curve
firstPoint, lastPoint = gh.EndPoints(Profile)
Height = lastPoint.Z - firstPoint.Z
if Height < 0: # Flip curve if its direction 
    Profile, _ = gh.FlipCurve(Profile)
    firstPoint, lastPoint = gh.EndPoints(Profile)
    Height = lastPoint.Z - firstPoint.Z
layerCount = int(Height/LayerHeight)

# Determine radii for each layer using horizontal frames
vectors = [rs.CreateVector(0,0,firstPoint.Z+z*LayerHeight) for z in range(0, layerCount)]
planes, _ = gh.Move(_xyPlane, vectors)
points, _, _ = gh.CurveXPlane(Profile, planes)
Radii = [0 for i in points]
for i, p in enumerate(points):
    Radii[i] = math.sqrt(p.X*p.X+p.Y*p.Y)
Radii.append(Radii[-1]) # rim layer radius, repeat last radius

# Make the base
for i in range(BaseLayerCount):
    makeBaseLayers(i)

# Make the walls
makeWalls()

# Visualize surface for textures
rail = []
_profile, _ = gh.Move(Profile, [gh.UnitX(0.7), gh.UnitX(-0.7)])
if nPoints == 2:
    rail = gh.Circle(_xyPlane, Radii[0])
else:
    rail, _ = gh.Polygon(_xyPlane, Radii[0], nPoints, 0)
surface = gh.RailRevolution(_profile, rail, gh.Line(_ogPoint, _upOgPoint), 1)
surface, _ = gh.Move(surface, gh.UnitZ(BaseLayerCount*2*LayerHeight))
# ---------- end p_parametriccylinderwithbase ----------

# ---- group: Visualize surface
material_2 = CreateMaterial(
    Diffuse=ColourSwatch(SwatchColor=RGB(31, 33, 28)),
    Specular=RGB(255, 255, 255),
    Emission=RGB(0, 0, 0),
    Transparency=0,
    Shine=Slider(0, range=0..1))
preview_2 = CustomPreview(Geometry=p_parametriccylinderwithbase.surface, Material=material_2)

# ----
use_image = BooleanToggle(False)
image = ImageSampler(p_parametriccylinderwithbase.wallUVs, Filter="Value", Interpolate=True, Umax=1, Umin=0, Vmax=1, Vmin=0, Wrap=1)

invert_colors = Subtraction(A=1, B=image)
slice_model = SliceModel(
    nozzle_width=nozzle_diam_mm_2,
    layer_height=layer_height_mm_2,
    geometry=_2msh,
    wall_count=wall_count,
    wall_order=wall_order)  # -> closed, layers
move = Move(Geometry=p_readgcode.vertices, Motion=expr("-x", p_readgcode.origin))  # -> Geometry, Transform
ratio = Division(A=target_layer_height_mm, B=original_layer_height)
p_despiralize = GhPythonScript(ogVertices=move.Geometry, ogLayerH=original_layer_height, wallCount=wall_count_3)  # -> layers; inputs ogVertices: list of Point3d
# ---------- p_despiralize: Python ----------
__author__ = "mert_"
__version__ = "2023.08.03"

import rhinoscriptsyntax as rs
import ghpythonlib.components as gh
import ghpythonlib.treehelpers as th

# if multi wall
if wallCount > 1:
    def group_by_z(points):
        grouped = {}
        for point in points:
            z = point[2]
            if z not in grouped:
                grouped[z] = []
            grouped[z].append(point)
        
        return [grouped[key] for key in sorted(grouped.keys())]
    
    # make sure the layers are not spiralized
    for p in ogVertices:
        layer = p.Z // ogLayerH
        p.Z = layer * ogLayerH
        
    # define layers
    groupedVertices = group_by_z(ogVertices)
    
    layers = th.list_to_tree(groupedVertices)
else:
    layers = ogVertices
# ---------- end p_despiralize ----------

# ---- group: Points, Normals, UVs
isclosed = Boolean(simplify(graft(slice_model.closed)))
divlength = DivideLength(Curve=slice_model.layers, Length=point_distance_mm)  # -> simplify(Points), Tangents, Parameters
Z = UnitZ(Factor=1)
xprod = CrossProduct(VectorA=divlength.Tangents, VectorB=Z, Unitize=False)  # -> flatten(Vector), Length
p_uvs = GhPythonScript(x=divlength.Points)  # -> uvs; inputs x: tree of Point3d
# ---------- p_uvs: Python ----------
__author__ = "mert_"
__version__ = "2023.07.31"

import rhinoscriptsyntax as rs
import ghpythonlib as gh

layerCount = x.BranchCount

uvs = []
for i in range(layerCount):
    layer = x.Branch(i)
    for j in range(len(layer)):
        uv = rs.CreateVector(float(j)/len(layer), float(i)/layerCount)
        uvs.append(uv)
# ---------- end p_uvs ----------
vertices = Point(flatten(divlength.Points))

# ----
# won't work good
# if there are separate
# toolpaths in the
# same layer
use_image_2 = BooleanToggle(False)
image_2 = ImageSampler(p_uvs, Filter="Value", Interpolate=True, Umax=1, Umin=0, Vmax=1, Vmin=0, Wrap=1)

duppt = RemoveDuplicatePts(Points=p_despiralize, Tolerance=0.01)

# ---- group: Surface Texture
p_toolpathpattern = GhPythonScript(
    isApplied=enable_surface_textures,
    points=p_parametriccylinderwithbase.wallVertices,
    horizontal_pattern=layer_pattern,
    vertical_pattern=vertical_pattern,
    layer_height=layer_height_mm,
    isSkip=skip_w_geometry,
    skipG=capex_2.Brep)  # -> layered_pattern; inputs isApplied: Boolean, points: list of Point3d, horizontal_pattern: list, vertical_pattern: list, isSkip: Boolean, skipG: list of Brep
# ---------- p_toolpathpattern: Python ----------
__author__ = "mert_"
__version__ = "2022.04.25"

import rhinoscriptsyntax as rs
import ghpythonlib.components as gh
import math

# input
points
horizontal_pattern
vertical_pattern
layer_height

# return
layered_pattern = []

if isApplied == True:
    height = points[-1].Z
    
    layer_ptr = 0
    total_layers = points[-1].Z // layer_height
    for i, p in enumerate(points):
        layer_count = int(p.Z / layer_height)
        
        isInside = False
        if isSkip and skipG:
            isInside, gIdx = gh.PointInBreps(skipG, p, False)
        isLastLayer = math.fabs(height-p.Z) < layer_height
        
        vert_value = vertical_pattern[layer_count%len(vertical_pattern)]
        hor_value = horizontal_pattern[i%len(horizontal_pattern)]
        
        layered_pattern.append(int(not isLastLayer)*int(not isInside)*int(vert_value)*int(hor_value))
        
        if layer_count == layer_ptr:
            layer_ptr += 1
else:
    layered_pattern = [0]*len(points)
# ---------- end p_toolpathpattern ----------
p_imagemapping = GhPythonScript(isImage=use_image, pixels=invert_colors, normals=p_parametriccylinderwithbase.wallNormals, scale=pattern_strength)  # -> mod_normals; inputs isImage: Boolean, pixels: list, normals: list of Vector3d
# ---------- p_imagemapping: Python ----------
__author__ = "mert_"
__version__ = "2023.06.22"

import rhinoscriptsyntax as rs

mod_normals = []
if isImage:
    for i, n in enumerate(normals):
        mod_normals.append(n*scale*pixels[i])
else:
    for n in normals:
        mod_normals.append(n*scale)
# ---------- end p_imagemapping ----------
multiplication = Multiplication(A=p_toolpathpattern, B=p_imagemapping)
move_2 = Move(Geometry=p_parametriccylinderwithbase.wallVertices, Motion=multiplication)  # -> Geometry, Transform

# ---- group: Visualize normals
v_normal = VectorDisplay(Anchor=p_parametriccylinderwithbase.wallVertices, Vector=expr("x*2", multiplication))  # disabled

# ----
pline = PolyLine(Vertices=duppt, Closed=False)
p_flp = GhPythonScript(x=pline)  # -> simplify(graft(x)); inputs x: tree of Polyline; same code as p_flp

# ---- group: multiwall
series = Series(Start=0, Step=expr("-0.90*x", target_nozzle_diam_mm), Count=wall_count_3)
xy = XYPlane(Origin=Point(0, 0, 0))
offset_2 = OffsetCurve(Curve=p_flp, Distance=series, Plane=xy, Corners=3)
trim = TrimTree(Tree=offset_2, Depth=1)
rev = ReverseList(List=trim)
filter = StreamFilter(Gate=wall_order_3, Stream0=rev, Stream1=trim)
cp = ControlPoints(Curve=filter)  # -> Points, Weights, Knots

# ---- group: Surface Texture
p_toolpathpattern_2 = GhPythonScript(
    isApplied=enable_surface_textures_2,
    points=vertices,
    horizontal_pattern=layer_pattern_2,
    vertical_pattern=vertical_pattern_2,
    layer_height=layer_height_mm_2,
    isSkip=skip_w_geometry_2,
    skipG=capex.Brep)  # -> layered_pattern; inputs isApplied: Boolean, points: list of Point3d, horizontal_pattern: list, vertical_pattern: list, isSkip: Boolean, skipG: list of Brep; same code as p_toolpathpattern
p_imagemapping_2 = GhPythonScript(isImage=use_image_2, pixels=image_2, normals=xprod.Vector, scale=pattern_strength_2)  # -> mod_normals; inputs isImage: Boolean, pixels: list, normals: list of Vector3d; same code as p_imagemapping
multiplication_2 = Multiplication(A=p_toolpathpattern_2, B=p_imagemapping_2)
move_3 = Move(Geometry=flatten(vertices), Motion=multiplication_2)  # -> Geometry, Transform

# ---- group: Visualize normals
v_normal_2 = VectorDisplay(Anchor=divlength.Points, Vector=expr("x*2", multiplication_2))

# ----
flatten = FlattenTree(Tree=cp.Points, Path="{0}")
merge = Merge(Data1=p_parametriccylinderwithbase.baseVertices, Data2=move_2.Geometry)  # -> flatten(Result)
scale = Scale(Geometry=flatten, Center=Point(0, 0, 0), Factor=ratio)  # -> Geometry, Transform
scale_nu = ScaleNU(Geometry=flatten, Plane=PlaneXY(0, 0, 0), ScaleX=1, ScaleY=1, ScaleZ=ratio)  # -> Geometry, Transform
filter_2 = StreamFilter(Gate=scale_type, Stream0=scale.Geometry, Stream1=scale_nu.Geometry)

# ---- group: Height of the profile vessel
distance = Slider(11.4, range=-75..75)
# Visualizations
# Enable/Disable preview of
# the items on the far right
item = ListItem(List=filter_2, Index=0, Wrap=True)  # -> Item1, Item
py_dimout = GhPythonScript(firstP=item.Item, lastP=item.Item1, t=distance)  # -> L, A, B; inputs firstP: Point3d, lastP: Point3d
# ---------- py_dimout: Python ----------
__author__ = "mert_"
__version__ = "2023.08.02"

import rhinoscriptsyntax as rs
import ghpythonlib.components as gh

A = firstP
B = lastP

ls = rs.CreatePoint(A.X+t, 0, A.Z)
le = rs.CreatePoint(A.X+t, 0, B.Z)
L = rs.AddLine(ls, le)
# ---------- end py_dimout ----------
lineardim_2 = LinearDimension(Line=py_dimout.L, PointA=py_dimout.A, PointB=py_dimout.B, Text="{0:0.00 mm}", Size=Slider(6, range=1..20))

# ---- group: flip Y around center.Y for Scara
pdecon = Deconstruct(Point=filter_2)  # -> XComponent, YComponent, ZComponent; disabled
pdecon_2 = Deconstruct(Point=p_config_3.centerPoint)  # -> XComponent, YComponent, ZComponent; disabled
expression = Expression(py=pdecon.YComponent, cy=pdecon_2.YComponent, Expression="-(py-cy)+cy")  # disabled
pt = ConstructPoint(XCoordinate=pdecon.XComponent, YCoordinate=expression, ZCoordinate=pdecon.ZComponent)  # disabled

pdecon_3 = Deconstruct(Point=merge)  # -> XComponent, YComponent, ZComponent; disabled
pdecon_4 = Deconstruct(Point=p_config.centerPoint)  # -> XComponent, YComponent, ZComponent; disabled
expression_2 = Expression(py=pdecon_3.YComponent, cy=pdecon_4.YComponent, Expression="-(py-cy)+cy")  # disabled
pt_2 = ConstructPoint(XCoordinate=pdecon_3.XComponent, YCoordinate=expression_2, ZCoordinate=pdecon_3.ZComponent)  # disabled

pdecon_5 = Deconstruct(Point=move_3.Geometry)  # -> XComponent, YComponent, ZComponent; disabled
pdecon_6 = Deconstruct(Point=p_config_2.centerPoint)  # -> XComponent, YComponent, ZComponent; disabled
expression_3 = Expression(py=pdecon_5.YComponent, cy=pdecon_6.YComponent, Expression="-(py-cy)+cy")  # disabled
pt_3 = ConstructPoint(XCoordinate=pdecon_5.XComponent, YCoordinate=expression_3, ZCoordinate=pdecon_5.ZComponent)  # disabled

# ----
# Save Gcode
click_here_to_save = Button()
# Visualizations
# Enable/Disable preview of
# the items on the far right
# BASIC
# SLICER
right_click_select_directory = FilePath()

# ----
# Save Gcode
click_here_to_save_2 = Button()
# Visualizations
# Enable/Disable preview of
# the items on the far right
right_click_select_directory_2 = FilePath()

# ---- group: Height of the profile vessel
# PARAMETRIC
#      VESSEL
distance_2 = Slider(71.5, range=2..100)

# ----
# Save Gcode
# (RE)EXPORT
#      GCODE
right_click_select_directory_3 = FilePath()
click_here_to_save_3 = Button()

# ---- group: Visualize point order
pointsize = Slider(0.8, range=0.1..2)

# ----
# GCode
# mm -- for Potterbots
vertices_2 = Point(flatten(merge))

# ---- group: Height of the profile vessel (continued)
item_2 = ListItem(List=vertices_2, Index=0, Wrap=True)  # -> Item1, Item
py_dimout_2 = GhPythonScript(firstP=item_2.Item, lastP=item_2.Item1, t=distance_2)  # -> L, A, B; inputs firstP: Point3d, lastP: Point3d; same code as py_dimout
lineardim_3 = LinearDimension(Line=py_dimout_2.L, PointA=py_dimout_2.A, PointB=py_dimout_2.B, Text="{0:0.00 mm}", Size=Slider(8, range=1..20))

# ---- group: Visualize toolpath
pline_2 = PolyLine(Vertices=vertices_2, Closed=False)
preview_3 = CustomPreview(Geometry=pline_2, Material=ColourSwatch(SwatchColor=RGB(220, 242, 138)))

# ---- group: Visualize point order (continued)
points = PointList(Points=vertices_2, Size=pointsize)  # disabled

# ---- group: Move to print bed
pline_3 = PolyLine(Vertices=vertices_2, Closed=False)
box = EvaluateBox(Box=pline_3, UParameter="0.5", VParameter="0.5", WParameter="0")  # -> Plane, Point, Include
move2pt = MoveToPoint(Geometry=vertices_2, PointA=box.Point, PointB=p_config.centerPoint)  # -> Moved, Vector, Transform

# ----
# GCode
# mm
vertices_3 = Point(flatten(filter_2))

# ---- group: Visualize toolpath
pline_4 = PolyLine(Vertices=vertices_3, Closed=False)
preview_4 = CustomPreview(Geometry=pline_4, Material=ColourSwatch(SwatchColor=RGB(242, 205, 167)))

# ---- group: Move to print bed
pline_5 = PolyLine(Vertices=vertices_3, Closed=False)
box_2 = EvaluateBox(Box=pline_5, UParameter="0.5", VParameter="0.5", WParameter="0")  # -> Plane, Point, Include
move2pt_2 = MoveToPoint(Geometry=vertices_3, PointA=box_2.Point, PointB=p_config_3.centerPoint)  # -> Moved, Vector, Transform

# ----
# GCode
# mm
vertices_4 = Point(flatten(move_3.Geometry))

# ---- group: Visualize toolpath
pline_6 = PolyLine(Vertices=vertices_4, Closed=False)
preview_5 = CustomPreview(Geometry=pline_6, Material=ColourSwatch(SwatchColor=RGB(220, 242, 138)))

# ---- group: Move to print bed
pline_7 = PolyLine(Vertices=vertices_4, Closed=False)
box_3 = EvaluateBox(Box=pline_7, UParameter="0.5", VParameter="0.5", WParameter="0")  # -> Plane, Point, Include
move2pt_3 = MoveToPoint(Geometry=vertices_4, PointA=box_3.Point, PointB=p_config_2.centerPoint)  # -> Moved, Vector, Transform

# ----
p_gcode = GhPythonScript(
    vertices=move2pt.Moved,
    printer=list,
    nozzleWidth=nozzle_diam_mm,
    layerHeight=layer_height_mm,
    printSpeed=print_speed_mm_s,
    tubeDiameter=p_config.tubeDiameter,
    isAutoExtrude=auto_extrusion_mult,
    extrudeMult=extrusion_multiplier)  # -> gcode, tubeUsage; inputs vertices: list of Point3d, isAutoExtrude: Boolean
# ---------- p_gcode: Python ----------
__author__ = "mert_"
__version__ = "2023.08.15"

import rhinoscriptsyntax as rs
import ghpythonlib.components as gh
import math

# Output
gcode = []

# temp variables
layerToNozzleRatio = layerHeight/nozzleWidth
_speed = 0    # current speed
_z = -10.0    # current height
_cumE = 0.0   # cumulative extrusion
_absE = 0.0   # absolute extrusion (does not reset)
_height = 0.0 # total height of the object

# layer_index [0.0, 1.0]:: 0 first layer and 1 last layer
def adjustExtrusion(e, layer_index=1):
    _e = 0
    if isAutoExtrude:
        if printer == "Potterbot 10 Super" or printer == "Potterbot Scara":
            _e = e*(nozzleWidth/1.9)*(nozzleWidth/1.9)
        elif printer == "Potterbot Micro":
            _e = e*(nozzleWidth/1.8)*(nozzleWidth/1.8)
        else: # "LUTUM 5", "BRUTUM", "Eazao"
            _e = e*extrudeMult
    else:
        _e = e*extrudeMult
        
    # adjust extrusion based on height (layer_index)
#    _min, _max = 0.85, 1.2
#    _c = -(_max-_min)*layer_index+_max
#    _e *= _c
    return _e

def calculateExtrusion(fromP, toP):
    global _cumE, _absE
    
    # reset values every 5000 mm 
    if _cumE > 5000:
        gcode.append("G92 E0")
        _cumE = 0
    
    dist = rs.Distance(fromP, toP)
    e = dist*layerToNozzleRatio*(layerToNozzleRatio+1.2732395447) #4/pi
#    **TODO** : if travelling far, don't extrude
#    if dist > ??: 
#        e = 0
    _absE += e
    _cumE += e # <- this one gets reset
    
    return _cumE

def makeG1Line(fromP, toP, speed):
    global _speed, _z
    
    e = calculateExtrusion(fromP, toP)
#    e = adjustExtrusion(e)
    e = adjustExtrusion(e, toP.Z/_height)
    if speed == _speed and toP.Z == _z:
        line = "G1 X{0:.2f} Y{1:.2f} E{2:.8f}".format(toP.X,toP.Y,e)
    elif speed != _speed and toP.Z == _z:
        _speed = speed
        line = "G1 F{3}\nG1 X{0:.2f} Y{1:.2f} E{2:.8f}".format(toP.X,toP.Y,e,_speed)
    elif speed == _speed and toP.Z != _z:
        _z = toP.Z
        line = "G1 X{0:.2f} Y{1:.2f} Z{3:.2f} E{2:.8f}".format(toP.X,toP.Y,e,toP.Z)
    else:
        _z, _speed = toP.Z, speed
        line = "G1 F{3} X{0:.2f} Y{1:.2f} Z{2:.2f} E{4:.8f}".format(toP.X,toP.Y,toP.Z,_speed,e)
    gcode.append(line)
def makeG0Line(toP, speed):
    global _speed, _z
    
    if speed == _speed and toP.Z == _z:
        line = "G0 X{0:.2f} Y{1:.2f}".format(toP.X,toP.Y)
    elif speed != _speed and toP.Z == _z:
        _speed = speed
        line = "G0 F{2}\nG1 X{0:.2f} Y{1:.2f} ".format(toP.X,toP.Y, _speed)
    elif speed == _speed and toP.Z != _z:
        _z = toP.Z
        line = "G0 X{0:.2f} Y{1:.2f} Z{2:.2f}".format(toP.X,toP.Y,toP.Z)
    else:
        _z, _speed = toP.Z, speed
        line = "G0 F{3} X{0:.2f} Y{1:.2f} Z{2:.2f}".format(toP.X, toP.Y, toP.Z, _speed)
    gcode.append(line)

# Last point's Z value
_height = vertices[-1].Z

# Create gcode lines from points
vprev = 0 
for i, v in enumerate(vertices):
    if i == 0:
        makeG0Line(v, printSpeed*60.0)
    else:
        makeG1Line(vprev, v, printSpeed*60.0)
    vprev = v

tubeUsage = ((nozzleWidth*0.5)*(nozzleWidth*0.5)*_absE)/((tubeDiameter*0.5)*(tubeDiameter*0.5))
if tubeDiameter < 0:
    tubeUsage = "N/A"
gcode = '\n'.join(gcode)
# ---------- end p_gcode ----------
panel_2 = Panel(p_gcode.tubeUsage)

p_configparameters = GhPythonScript(
    version=current_version,
    printer=list,
    pspeed=print_speed_mm_s,
    nozzle=nozzle_diam_mm,
    layerh=layer_height_mm,
    nBase=base_layers,
    nWall=wall_count_2,
    oWall=wall_order_2,
    nRim=rim_layers,
    nPoints=of_points,
    isTex=enable_surface_textures,
    texStren=pattern_strength,
    hPat=layer_pattern,
    vPat=vertical_pattern,
    isIm=use_image,
    isGeo=skip_w_geometry,
    autoExtrude=auto_extrusion_mult,
    extrudeMult=extrusion_multiplier,
    tubeUse=p_gcode.tubeUsage)  # -> o; inputs hPat: list of Int32, vPat: list of Int32, autoExtrude: Boolean
# ---------- p_configparameters: Python ----------
__author__ = "mert_"
__version__ = "2023.07.31"

import rhinoscriptsyntax as rs
from datetime import datetime

current_time_date = datetime.now().strftime('%Y-%m-%d %H:%M:%S')

wallOrder = "Outside-in"
if oWall == 0:
    wallOrder = "Inside-out"

o = """;GH Params - Parametric Vessel ({17})\n;==================
{16}\n;==================
;Printer:          {0}
;Print speed:      {1}
;Nozzle width:     {2}
;Layer height:     {3}
;Auto-extrusion:   {18}  --only works with Potterbots
;Extrusion Mult:   {19}    --N/A, if auto is True
; SOME PROFILE CURVE
;# of base layers: {4}
;# of walls:       {5}
;Wall order:       {6}
;# of rim layers:  {7}
;# of points:      {8} 
;Is Textured:      {9}
;Pattern strength: {10}
;Layer pattern:    {11}
;Vert pattern:     {12}
;Is Image:         {13}
; SOME IMAGE
;Is Geometry:      {14}
; SOME GEOMETRY

; Tube usage:      {15} mm
""".format(printer, pspeed, nozzle, layerh, nBase, nWall, wallOrder, nRim, 
nPoints, isTex, texStren, hPat, vPat, isIm, isGeo, tubeUse, 
current_time_date, version, autoExtrude, extrudeMult)
# ---------- end p_configparameters ----------

merge_2 = Merge(Data1=p_configparameters, Data2=p_config.startGcode, Data3=p_gcode.gcode, Data4=p_config.endGcode)

p_savefile = GhPythonScript(isSave=click_here_to_save_2, path=right_click_select_directory_2, gcode=merge_2)  # -> saved; inputs isSave: Boolean, gcode: list
# ---------- p_savefile: Python ----------
__author__ = "mert_"
__version__ = "2023.06.22"

import rhinoscriptsyntax as rs
import os
import platform

if isSave:
    num_files = len(os.listdir(path))
    full_filename = ""
    if platform.system() == "Windows":
      full_filename = "{0}\\GH_export_{1}.gcode".format(path, num_files)
    else:
      full_filename = "{0}/GH_export_{1}.gcode".format(path, num_files)
    
    with open(full_filename, 'w') as f:
        f.write('\n'.join(gcode))
        saved = "saved in {0}".format(path)
# ---------- end p_savefile ----------
panel_3 = Panel(p_savefile)

panel_4 = Panel(p_configparameters)

p_gcode_2 = GhPythonScript(
    vertices=move2pt_2.Moved,
    printer=list_3,
    nozzleWidth=target_nozzle_diam_mm,
    layerHeight=target_layer_height_mm,
    printSpeed=target_print_speed_mm_s,
    tubeDiameter=p_config_3.tubeDiameter,
    isAutoExtrude=auto_extrusion_mult_3,
    extrudeMult=extrusion_multiplier_3)  # -> gcode, tubeUsage; inputs vertices: list of Point3d, isAutoExtrude: Boolean
# ---------- p_gcode_2: Python ----------
__author__ = "mert_"
__version__ = "2023.08.15"

import rhinoscriptsyntax as rs
import ghpythonlib.components as gh
import math

# Output
gcode = []

# temp variables
layerToNozzleRatio = layerHeight/nozzleWidth
_speed = 0    # current speed
_z = -10.0    # current height
_cumE = 0.0   # cumulative extrusion
_absE = 0.0   # absolute extrusion (does not reset)

def adjustExtrusion(e):
    _e = 0
    if isAutoExtrude:
        if printer == "Potterbot 10 Super" or printer == "Potterbot Scara":
            _e = e*(nozzleWidth/1.9)*(nozzleWidth/1.9)
        elif printer == "Potterbot Micro":
            _e = e*(nozzleWidth/1.8)*(nozzleWidth/1.8)
        else: # "LUTUM 5", "BRUTUM", "Eazao"
            _e = e*extrudeMult
    else:
        _e = e*extrudeMult
    return _e
def calculateExtrusion(fromP, toP):
    global _cumE, _absE
    
    # reset values every 5000 mm 
    if _cumE > 5000:
        gcode.append("G92 E0")
        _cumE = 0
    
    dist = rs.Distance(fromP, toP)
    e = dist*layerToNozzleRatio*(layerToNozzleRatio+1.2732395447) #4/pi
#    **TODO** : if travelling far, don't extrude
#    if dist > ??: 
#        e = 0
    _absE += e
    _cumE += e # <- this one gets reset
    
    return _cumE

def makeG1Line(fromP, toP, speed):
    global _speed, _z
    
    e = calculateExtrusion(fromP, toP)
    e = adjustExtrusion(e)
    if speed == _speed and toP.Z == _z:
        line = "G1 X{0:.2f} Y{1:.2f} E{2:.8f}".format(toP.X,toP.Y,e)
    elif speed != _speed and toP.Z == _z:
        _speed = speed
        line = "G1 F{3}\nG1 X{0:.2f} Y{1:.2f} E{2:.8f}".format(toP.X,toP.Y,e,_speed)
    elif speed == _speed and toP.Z != _z:
        _z = toP.Z
        line = "G1 X{0:.2f} Y{1:.2f} Z{3:.2f} E{2:.8f}".format(toP.X,toP.Y,e,toP.Z)
    else:
        _z, _speed = toP.Z, speed
        line = "G1 F{3} X{0:.2f} Y{1:.2f} Z{2:.2f} E{4:.8f}".format(toP.X,toP.Y,toP.Z,_speed,e)
    gcode.append(line)
def makeG0Line(toP, speed):
    global _speed, _z
    
    if speed == _speed and toP.Z == _z:
        line = "G0 X{0:.2f} Y{1:.2f}".format(toP.X,toP.Y)
    elif speed != _speed and toP.Z == _z:
        _speed = speed
        line = "G0 F{2}\nG1 X{0:.2f} Y{1:.2f} ".format(toP.X,toP.Y, _speed)
    elif speed == _speed and toP.Z != _z:
        _z = toP.Z
        line = "G0 X{0:.2f} Y{1:.2f} Z{2:.2f}".format(toP.X,toP.Y,toP.Z)
    else:
        _z, _speed = toP.Z, speed
        line = "G0 F{3} X{0:.2f} Y{1:.2f} Z{2:.2f}".format(toP.X, toP.Y, toP.Z, _speed)
    gcode.append(line)

# Create gcode lines from points
vprev = 0 
for i, v in enumerate(vertices):
    if i == 0:
        makeG0Line(v, printSpeed*60.0)
    else:
        makeG1Line(vprev, v, printSpeed*60.0)
    vprev = v

tubeUsage = ((nozzleWidth*0.5)*(nozzleWidth*0.5)*_absE)/((tubeDiameter*0.5)*(tubeDiameter*0.5))
if tubeDiameter < 0:
    tubeUsage = "N/A"
gcode = '\n'.join(gcode)
# ---------- end p_gcode_2 ----------
panel_5 = Panel(p_gcode_2.tubeUsage)

p_configparameters_2 = GhPythonScript(
    version=current_version,
    ogGcode=right_click_select_one_existing_file,
    ogLayerH=original_layer_height,
    printer=list_3,
    pspeed=target_print_speed_mm_s,
    nozzle=target_nozzle_diam_mm,
    layerh=target_layer_height_mm,
    wallC=wall_count_3,
    wallO=wall_order_3,
    scaleT=scale_type,
    autoExtrude=auto_extrusion_mult_3,
    extrudeMult=extrusion_multiplier_3,
    tubeUse=p_gcode_2.tubeUsage)  # -> o
# ---------- p_configparameters_2: Python ----------
__author__ = "mert_"
__version__ = "2023.07.31"

import rhinoscriptsyntax as rs
from datetime import datetime

current_time_date = datetime.now().strftime('%Y-%m-%d %H:%M:%S')

wallOrder = "Inside-Out"
if wallO == 1:
    wallOrder = "Outside-in"
    
scaleType = "Scale Uniformly"
if scaleT == 1:
    scaleType = "Scale Z Only"

o = """;GH Params - Converted GCode ({11}) \n;==================
{10}\n;==================
;Original GCode:     {0}
;Original layer h:   {1}
;Target printer:     {2}
;Target speed:       {3}
;Target nozzle w:    {4}
;Target layer h:     {5}
;Auto-extrusion:     {12}  --only works with Potterbots
;Extrusion Mult:     {13}    --N/A, if auto is True
;Target wall count:  {6}
;Target wall order:  {7}
;Target scale type:  {8}

;Target tube usage:  {9}mm
""".format(ogGcode, ogLayerH, printer, pspeed, nozzle, layerh, 
wallC,
wallOrder,
scaleType,
tubeUse, 
current_time_date,
version,
autoExtrude,
extrudeMult)
# ---------- end p_configparameters_2 ----------

merge_3 = Merge(Data1=p_configparameters_2, Data2=p_config_3.startGcode, Data3=p_gcode_2.gcode, Data4=p_config_3.endGcode)

p_savefile_2 = GhPythonScript(isSave=click_here_to_save_3, path=right_click_select_directory_3, gcode=merge_3)  # -> saved; inputs isSave: Boolean, gcode: list; same code as p_savefile
panel_6 = Panel(p_savefile_2)

panel_7 = Panel(p_configparameters_2)

p_gcode_3 = GhPythonScript(
    vertices=move2pt_3.Moved,
    printer=list_2,
    nozzleWidth=nozzle_diam_mm_2,
    layerHeight=layer_height_mm_2,
    printSpeed=print_speed_mm_s_2,
    tubeDiameter=p_config_2.tubeDiameter,
    isAutoExtrude=auto_extrusion_mult_2,
    extrudeMult=extrusion_multiplier_2,
    TextureScale=pattern_strength_2,
    PointDistance=point_distance_mm)  # -> gcode, tubeUsage; inputs vertices: list of Point3d, isAutoExtrude: Boolean
# ---------- p_gcode_3: Python ----------
__author__ = "mert_"
__version__ = "2023.08.15"

import rhinoscriptsyntax as rs
import ghpythonlib.components as gh
import math

# Output
gcode = []

# temp variables
layerToNozzleRatio = layerHeight/nozzleWidth
_speed = 0    # current speed
_z = -10.0    # current height
_cumE = 0.0   # cumulative extrusion
_absE = 0.0   # absolute extrusion (does not reset)

def adjustExtrusion(e):
    _e = 0
    if isAutoExtrude:
        if printer == "Potterbot 10 Super" or printer == "Potterbot Scara":
            _e = e*(nozzleWidth/1.9)*(nozzleWidth/1.9)
        elif printer == "Potterbot Micro":
            _e = e*(nozzleWidth/1.8)*(nozzleWidth/1.8)
        else: # "LUTUM 5", "BRUTUM", "Eazao"
            _e = e*extrudeMult
    else:
        _e = e*extrudeMult
    return _e
def calculateExtrusion(fromP, toP):
    global _cumE, _absE
    
    # reset values every 5000 mm 
    if _cumE > 5000:
        gcode.append("G92 E0")
        _cumE = 0
    
    dist = rs.Distance(fromP, toP)
    e = dist*layerToNozzleRatio*(layerToNozzleRatio+1.2732395447) #4/pi
    ### if travelling far, don't extrude
    if dist > 2*PointDistance + math.fabs(TextureScale): 
        e = 0
    _absE += e
    _cumE += e # <- this one gets reset
    
    return _cumE

def makeG1Line(fromP, toP, speed):
    global _speed, _z
    
    e = calculateExtrusion(fromP, toP)
    e = adjustExtrusion(e)
    if speed == _speed and toP.Z == _z:
        line = "G1 X{0:.2f} Y{1:.2f} E{2:.8f}".format(toP.X,toP.Y,e)
    elif speed != _speed and toP.Z == _z:
        _speed = speed
        line = "G1 F{3}\nG1 X{0:.2f} Y{1:.2f} E{2:.8f}".format(toP.X,toP.Y,e,_speed)
    elif speed == _speed and toP.Z != _z:
        _z = toP.Z
        line = "G1 X{0:.2f} Y{1:.2f} Z{3:.2f} E{2:.8f}".format(toP.X,toP.Y,e,toP.Z)
    else:
        _z, _speed = toP.Z, speed
        line = "G1 F{3} X{0:.2f} Y{1:.2f} Z{2:.2f} E{4:.8f}".format(toP.X,toP.Y,toP.Z,_speed,e)
    gcode.append(line)
def makeG0Line(toP, speed):
    global _speed, _z
    
    if speed == _speed and toP.Z == _z:
        line = "G0 X{0:.2f} Y{1:.2f}".format(toP.X,toP.Y)
    elif speed != _speed and toP.Z == _z:
        _speed = speed
        line = "G0 F{2}\nG1 X{0:.2f} Y{1:.2f} ".format(toP.X,toP.Y, _speed)
    elif speed == _speed and toP.Z != _z:
        _z = toP.Z
        line = "G0 X{0:.2f} Y{1:.2f} Z{2:.2f}".format(toP.X,toP.Y,toP.Z)
    else:
        _z, _speed = toP.Z, speed
        line = "G0 F{3} X{0:.2f} Y{1:.2f} Z{2:.2f}".format(toP.X, toP.Y, toP.Z, _speed)
    gcode.append(line)

# Create gcode lines from points
vprev = 0 
for i, v in enumerate(vertices):
    if i == 0:
        makeG0Line(v, printSpeed*60.0)
    else:
        makeG1Line(vprev, v, printSpeed*60.0)
    vprev = v

tubeUsage = ((nozzleWidth*0.5)*(nozzleWidth*0.5)*_absE)/((tubeDiameter*0.5)*(tubeDiameter*0.5))
if tubeDiameter < 0:
    tubeUsage = "N/A"
gcode = '\n'.join(gcode)
# ---------- end p_gcode_3 ----------
panel_8 = Panel(p_gcode_3.tubeUsage)

p_configparameters_3 = GhPythonScript(
    version=current_version,
    printer=list_2,
    pspeed=print_speed_mm_s_2,
    nozzle=nozzle_diam_mm_2,
    layerh=layer_height_mm_2,
    pointDist=point_distance_mm,
    wallC=wall_count,
    wallO=wall_order,
    isTex=enable_surface_textures_2,
    texStren=pattern_strength_2,
    hPat=layer_pattern_2,
    vPat=vertical_pattern_2,
    isIm=use_image_2,
    isGeo=skip_w_geometry_2,
    autoExtrude=auto_extrusion_mult_2,
    extrudeMult=extrusion_multiplier_2,
    tubeUse=p_gcode_3.tubeUsage)  # -> o; inputs hPat: list of Int32, vPat: list of Int32
# ---------- p_configparameters_3: Python ----------
__author__ = "mert_"
__version__ = "2023.07.31"

import rhinoscriptsyntax as rs
from datetime import datetime

current_time_date = datetime.now().strftime('%Y-%m-%d %H:%M:%S')

wallOrder = "Outside-in"
if wallO == 0:
    wallOrder = "Inside-out"

o = """;GH Params - Basic Slicer ({15})\n;==================
{14}\n;==================
;Printer:          {0}
;Print speed:      {1}
;Nozzle width:     {2}
;Layer height:     {3}
;Auto-extrusion:   {16}  --only works with Potterbots
;Extrusion Mult:   {17}    --N/A, if auto is True
; SOME MESH/SURFACE
;Point distance:   {4}
;Wall count:       {12}
;Wall count:       {13}
;Point distance:   {4}
;Is Textured:      {5}
;Pattern strength: {6}
;Layer pattern:    {7}
;Vert pattern:     {8}
;Is Image:         {9}
; SOME IMAGE
;Is Geometry:      {10}
; SOME GEOMETRY

; Tube usage:      {11}mm
""".format(printer, pspeed, nozzle, layerh, pointDist, isTex, texStren, 
hPat, vPat, isIm, isGeo, tubeUse, wallC, wallOrder, 
current_time_date, version, autoExtrude, extrudeMult)
# ---------- end p_configparameters_3 ----------

merge_4 = Merge(Data1=p_configparameters_3, Data2=p_config_2.startGcode, Data3=p_gcode_3.gcode, Data4=p_config_2.endGcode)

p_savefile_3 = GhPythonScript(isSave=click_here_to_save, path=right_click_select_directory, gcode=merge_4)  # -> saved; inputs isSave: Boolean, gcode: list; same code as p_savefile
panel_9 = Panel(p_savefile_3)

# ----
# mm
panel_10 = Panel(p_configparameters_3)

# ==== cluster SliceModel
geometry = ClusterInput()
nozzle_width = ClusterInput()
layer_height = ClusterInput()
wall_count = ClusterInput()
wall_order = ClusterInput()
bbox = BoundingBox(Content=geometry, Plane=PlaneXY(0, 0, 0))  # -> Box, Box_2
debox = DeconstructBox(Box=bbox.Box)  # -> Plane, X, Y, Z
dedomain = DeconstructDomain(Domain=debox.Z)  # -> Start, End
subtraction = Subtraction(A=dedomain.End, B=dedomain.Start)
addition = Addition()
division = Division(A=subtraction, B=layer_height)
series = Series(Start=dedomain.Start, Step=layer_height, Count=division)
multiplication = Multiplication(A=nozzle_width, B=Slider(-0.9, range=-1..-0.5))
Z = UnitZ(Factor=series)
rectangle = Rectangle(Plane=PlaneXY(0, 0, 0), XSize=debox.X, YSize=debox.Y, Radius=0)  # -> Rectangle, Length
move = Move(Geometry=rectangle.Rectangle, Motion=Z)  # -> Geometry, Transform
series_2 = Series(Start=0, Step=multiplication, Count=expr("x", wall_count))
sec = MeshPlane(Mesh=geometry, Plane=move.Geometry)  # -> simplify(Curves)
xy = XYPlane(Origin=Point(0, 0, 0))
clean = CleanTree(RemoveNulls=True, RemoveInvalid=True, RemoveEmpty=True, Tree=sec)
p_flp = GhPythonScript(x=clean)  # -> x; inputs x: tree of Polyline
# ---------- p_flp: Python ----------
__author__ = "mert_"
__version__ = "2023.08.03"

import rhinoscriptsyntax as rs
import ghpythonlib.components as gh
import ghpythonlib.treehelpers as th

x_ = x
firstLayer = x.Branch(0)[0]
side, _,_ = gh.CurveSide(firstLayer, rs.CreatePoint(1000, 0, 0))
if side == -1:
    flipped, _ = gh.FlipCurve(x)
    x_ = flipped#gh.GraftTree(flipped)
# ---------- end p_flp ----------
offset = OffsetCurve(Curve=p_flp, Distance=series_2, Plane=xy, Corners=1)
trim = TrimTree(Tree=offset, Depth=1)
rev = ReverseList(List=trim)
# reverse the list if 0
filter = StreamFilter(Gate=wall_order, Stream0=rev, Stream1=trim)
clean_2 = CleanTree(RemoveNulls=True, RemoveInvalid=True, RemoveEmpty=True, Tree=filter)  # -> simplify(Tree)
cls = Closed(Curve=clean_2)  # -> Closed, Periodic
layers = ClusterOutput(clean_2)
closed = ClusterOutput(cls.Closed)
